# Dynamo graph A1 - Sandbox.dyn (Dynamo 0.8.1.1473)

# group: INPUTS
directory_path = Directory("C:\Users\adieckmann\Documents\GitHub\ClockworkForDynamo\package_samples\0.7.x\extra")
file_path_dynamo_file = Filename("C:\Users\adieckmann\Desktop\FamParam.dyn")
directory_path_journal_file = Directory("C:\Users\adieckmann\Desktop")
revit_version = StringInput("2015")

# group: Create list of Revit files
fromPath = DirectoryObject(directory_path)  # "Directory.FromPath"
code_block = CodeBlock { "*.rvt"; }
contents = Directory.Contents(fromPath, code_block)

# group: Create journal files
count = List.Count(contents)
code_block_2 = CodeBlock(n=count) { suffix = 1..n; "DynamoJournalFile_" + suffix; }
byPaths2 = Custom[RevitJournalFile.ByPaths2](RevitFile=contents, DynamoFile=file_path_dynamo_file, JournalDirectory=directory_path_journal_file, JournalFileName=code_block_2.out1)  # Creates a Revit journal file that starts Revit with a given project/family and launches the Dynamo addin with a given Dynamo graph.

# group: Batch-process Revit files
byVersion = Custom[RevitExecutablePath.ByVersion](RevitVersion=revit_version)  # Returns the path of Revit.exe based on a given Revit version
run = Custom[ExternalApplication.Run](ExecutablePath=byVersion)  # Launches a given external application with the given arguments
map = List.Map(list=byPaths2, f_x=run)
